# Grasshopper definition 23of25.gh (Grasshopper 1.0.7)
# plug-ins: BullAnt, Pancake

# [TODO]: Create Test Cylinder and Move to center of Bed
number_slider = Slider(105, range=0..1000)
baseplate = ConstructPoint(XCoordinate=number_slider, YCoordinate=number_slider, ZCoordinate=0)
unit_z = UnitZ(Factor=1)
cylinder = Cylinder(Base=baseplate, Radius=Slider(10, range=0..10), Length=Slider(1, range=0..1))
number_slider_2 = Slider(0.3, range=0..1)
# [TODO]: Create Contours / Perimeters)
cap_holes = CapHoles(Brep=cylinder)
# [TODO]: Create Infill Patterns
contour = Contour(Shape=cap_holes, Point=baseplate, Direction=unit_z, Distance=number_slider_2)
area = Area(Geometry=contour)  # -> Area, Centroid
deconstruct_vector = DeconstructVector(Vector=area.Centroid)  # -> XComponent, YComponent, ZComponent
panel = Panel(deconstruct_vector.ZComponent)
larger_than = LargerThan(FirstNumber=deconstruct_vector.ZComponent, SecondNumber=number_slider_2)  # -> LargerThan, OrEqualTo
cull_pattern = CullPattern(List=contour, CullPattern=larger_than.OrEqualTo)
# [TODO]: Combine Perimeters and Infill
unit_x = UnitX(Factor=1)
panel_2 = Panel(larger_than.OrEqualTo)
ext_width = Slider(0.48, range=0..1)
panel_3 = Panel(cull_pattern)
boundary_surfaces = BoundarySurfaces(Edges=cull_pattern)
point = Point(baseplate)
# [TODO]: Create Line Segments from Perimeters and Infill
contour_2 = Contour(Shape=boundary_surfaces, Point=point, Direction=unit_x, Distance=ext_width)
trim_tree = TrimTree(Tree=contour_2, Depth=Slider(2, range=0..10))
panel_4 = Panel(contour_2)
merge = Merge(Data1=simplify(cull_pattern), Data2=trim_tree)
panel_5 = Panel(trim_tree)
panel_6 = Panel(merge)

# ---- group: A second line for testing
construct_point = ConstructPoint(XCoordinate=Slider(10, range=-10..30), YCoordinate=Slider(10, range=-10..30), ZCoordinate=Slider(1, range=-10..30))
construct_point_2 = ConstructPoint(XCoordinate=Slider(10, range=-10..30), YCoordinate=Slider(20, range=-10..30), ZCoordinate=Slider(1, range=-10..30))
line = Line(StartPoint=construct_point, EndPoint=construct_point_2)

# ---- group: Example of a line for testing
# [TODO]: Use lines for testing gcode generation then replace with line segments from slicing
number_slider_3 = Slider(5, range=-10..30)
construct_point_3 = ConstructPoint(XCoordinate=number_slider_3, YCoordinate=Slider(1, range=-10..30), ZCoordinate=Slider(0, range=-10..30))
construct_point_4 = ConstructPoint(XCoordinate=Slider(30, range=-10..30), YCoordinate=Slider(1, range=-10..30), ZCoordinate=Slider(0, range=-10..30))
line_2 = Line(StartPoint=construct_point_3, EndPoint=construct_point_4)

# ----
divide_length = DivideLength(Curve=merge, Length=Slider(0.1, range=0..0.1))  # -> Points, Tangents, Parameters
polyline = PolyLine(Vertices=divide_length.Points, Closed=False)
ggsimplifypolyline = GgSimplifyPolyline(Polyline=polyline, Tol=0.001)
explode = Explode(Curve=ggsimplifypolyline, Recursive=True)  # -> Segments, Vertices
nozzle_diam = Slider(0.4, range=0..1)
layer_change_feed_rate = Slider(720, range=0..1000)
extrusion_feed_rate = Slider(600, range=0..1000)
travel_feed_rate = Slider(1200, range=0..10000)
# [TODO]: Initialize Input Parameters
filament_diam = Slider(1.75, range=0..10)
layer_height = Slider(0.3, range=0..1)
travel_feed_rate_2 = Panel("1200")
multiplication = Multiplication(A=nozzle_diam, B=Slider(1.2, range=0..10))
line_3 = Line([line_2, line])
# [TODO]: Implement the gcode generation algorithm in Python
# NOTE THAT THIS GCODE OUTPUT ASSUMES:
# - A PRUSA MK3S+ as the Printer
# - PLA Material
# - Extrusion Temperature: 215C
# - Heated Bed Temperature: 60C
ghpython_script = GhPythonScript(
    lines=flatten(line_3),
    nozzle_diameter=nozzle_diam,
    filament_diameter=filament_diam,
    layer_height=layer_height,
    extrusion_width=multiplication,
    travel_feed_rate=travel_feed_rate,
    layer_change_feed_rate=layer_change_feed_rate,
    extrusion_feed_rate=extrusion_feed_rate)  # -> out, gcode_output; inputs lines: list of Line
# ---------- ghpython_script: Python ----------
"""
    This file contains parameters, helpers, and setup to 
    create a basic gcode generation algorithm from line segments.
    
    The main 
    
    
    Inputs:
        lines: the line segments to be converted into gcode commands for extrusion 
        nozzle_diameter: the diameter of the 3D printer's nozzle
        filament_diameter: the diameter of the 3d printing filament
        layer_height: the height of each layer in the print
        extrusion_width: the width of the extruded line from the printer
        travel_feed_rate: the speed at which the extruder moves in X and Y
        layer_change_feed_rate: the speed at which teh extruder moves when 
        changing layers in the Z direction
        extrusion_feed_rate: the speed at which the extruder move when extruding

    Output:
        gcode_output: a string with gcode commands separate by new-lines"""

__author__ = "mrivera-cu"

import rhinoscriptsyntax as rs

import math


########## CONSTANTS BELOW ###############

# GCODE COMMANDS
COMMAND_MOVE = "G1"

# GCODE PARAM NAMES
PARAM_X = "X"
PARAM_Y = "Y"
PARAM_Z = "Z"
PARAM_E = "E"
PARAM_F = "F"

# Separates commands
COMMAND_DELIMITER = "\n"

# Precision for converting floats to strings
E_VALUE_PRECISION = 5
XYZ_VALUE_PRECISION = 3

# Float equality precision
FLOAT_EQUALITY_PRECISION = 5

#should_extrude
should_extrude = True

#### WARNING: DO NOT EDIT THE START GCODE! #####
start_gcode_lines = [";START GCODE",
    "M73 P0 R42",
    "M73 Q0 S43",
    "M201 X1000 Y1000 Z200 E5000 ; sets maximum accelerations, mm/sec^2",
    "M203 X200 Y200 Z12 E120 ; sets maximum feedrates, mm / sec",
    "M204 S1250 T1250 ; sets acceleration (S) and retract acceleration (R), mm/sec^2",
    "M205 X8.00 Y8.00 Z0.40 E4.50 ; sets the jerk limits, mm/sec",
    "M205 S0 T0 ; sets the minimum extruding and travel feed rate, mm/sec",
    ";TYPE:Custom",
    "M862.3 P \"MK3S\" ; printer model check",
    "M862.1 P0.4 ; nozzle diameter check",
    "M115 U3.13.3 ; tell printer latest fw version",
    "G90 ; use absolute coordinates",
    "M83 ; extruder relative mode",
    "M104 S215 ; set extruder temp",
    "M140 S60 ; set bed temp",
    "M190 S60 ; wait for bed temp",
    "M109 S215 ; wait for extruder temp",
    "G28 W ; home all without mesh bed level",
    "G80 X86.6877 Y64.7708 W85.2412 H59.1573 ; mesh bed levelling",
    "G1 Z0.2 F720",
    "G1 Y-3 F1000 ; go outside print area",
    "G92 E0",
    "G1 X60 E9 F1000 ; intro line",
    "G1 X100 E12.5 F1000 ; intro line",
    "G92 E0",
    "M221 S95",
    "; Don't change E values below. Excessive value can damage the printer.",
    "M907 E538 ; set extruder motor current",
    "G21 ; set units to millimeters",
    "G90 ; use absolute coordinates",
    "M83 ; use relative distances for extrusion",
    "M900 K0.05 ; Filament gcode LA 1.5",
    "M900 K30 ; Filament gcode LA 1.0",
    "M107"]
    
##### WARNING: DO NOT EDIT THE END GCODE! ######
end_gcode_lines = ["; END Gcode", 
    "M204 S1000", 
    "M107", 
    ";TYPE:Custom", 
    "; Filament-specific end gcode", 
    "G1 Z180 F720 ; Move print head further up", 
    "G1 X0 Y200 F3600 ; park", 
    "G4 ; wait",
    "M221 S100 ; reset flow",
    "M900 K0 ; reset LA",
    "M104 S0 ; turn off temperature",
    "M140 S0 ; turn off heatbed",
    "M107 ; turn off fan",
    "M84 ; disable motors",
    "M73 P100 R0 ; print progress done",
    "M73 Q100 S0 ; print progress done"]

#########################################################################

# Converts a float (f) to a string with some precision of decimal places
# For example: 
# Input: f=0.1234, precision=3 
# Output: "0.123"
def float_to_string(f, precision=XYZ_VALUE_PRECISION): 
    f = float(f)
    str_format = "{value:." + str(precision) +"f}"
    return str_format.format(value=f)
    
# Helper to convert the E value to the proper precision
def e_value_to_string(e):
    return float_to_string(e, E_VALUE_PRECISION)

# Helper to convert the XYZ value to the proper precision
def xyz_value_to_string(e):
    return float_to_string(e, XYZ_VALUE_PRECISION)

def calculate_extrusion_amount(current_pos, next_pos, nozzle_diameter, filament_diameter, extrusion_width):
    # Calculate the distance between current position and next position
    distance = math.sqrt((next_pos[0] - current_pos[0])**2 + 
                         (next_pos[1] - current_pos[1])**2 +
                         (next_pos[2] - current_pos[2])**2)

    # Calculate the cross-sectional area of the extruded material
    # Assuming circular cross-section
    extrusion_area = math.pi * (extrusion_width / 2)**2

    # Calculate the volume of material needed for the extrusion
    volume = extrusion_area * distance

    # Calculate the filament displacement (length) based on the volume
    # Assuming the filament is a cylinder with diameter filament_diameter
    filament_displacement = volume / ((filament_diameter / 2)**2 * math.pi)

    return filament_displacement

#########################################################################

# Helper function to compare floats in grasshopper/python due to float precision errors
def are_floats_equal(f1, f2, epsilon=10**(-FLOAT_EQUALITY_PRECISION)):
    f1 *= 10**FLOAT_EQUALITY_PRECISION
    f2 *= 10**FLOAT_EQUALITY_PRECISION
    return math.fabs(f2 - f1) <= epsilon
    
# Helper function to compare if two points are equal (have the same coordinates)
# by handling float precision comparisons
def is_same_pt(ptA, ptB):
    return are_floats_equal(ptA[0], ptB[0]) and are_floats_equal(ptA[1], ptB[1]) and are_floats_equal(ptA[2], ptB[2])
     
     
########################################################################
# creates a string consisting of a G1 move command and 
# any associated parameters
def gcode_move(current_pos, next_pos, feed_rate=None, shouldExtrude=False):
    # Start with "G1" as command
    move_command_str = COMMAND_MOVE
    
    # Compare X positions
    if (not are_floats_equal(current_pos[0],next_pos[0])):
        # we have a different x position so add it as a parameter to the command
        x_value = float_to_string(next_pos[0], precision=XYZ_VALUE_PRECISION)
        # Add X<x_value> to move string, e.g., X100.00
        move_command_str += " " + PARAM_X + x_value
    
    # Compare Y positions
    if (not are_floats_equal(current_pos[1], next_pos[1])):
        # we have a different y position so add the new position as a parameter
        y_value = float_to_string(next_pos[1], precision=XYZ_VALUE_PRECISION)
        # Add Y<y_value> to move string, e.g., Y100.00
        move_command_str += " " + PARAM_Y + y_value
    
    # Compare Z position
    if (not are_floats_equal(current_pos[2], next_pos[2])):
        # we have a different z position so add the new position as a parameter
        z_value = float_to_string(next_pos[2], precision=XYZ_VALUE_PRECISION)
        # Add Z<z_value> to move string, e.g., Z100.00
        move_command_str += " " + PARAM_Z + z_value
    
    # [TODO]: handle "should_extrude" == true by determining the proper amount to
    # extrude using the capsule model, then append the E parameter and value
    # to the move command.
    # NOTE: YOUR FLOAT PRECISION MUST MATCH E_VALUE_PRECISION
    
    if (should_extrude == True) :
        extrusion_amount = calculate_extrusion_amount(current_pos, next_pos, nozzle_diameter, filament_diameter, extrusion_width)
        # Add extrusion parameter to the move command
        move_command_str += " " + PARAM_E + e_value_to_string(extrusion_amount)
        
    # See if we have a feedrate to use, and handle it differently than other 
    # parameters as it is an integer value
    if (feed_rate is not None):
        # feed rate is an int
        feed_rate_value = round(feed_rate)
        # Add F<feed_rate_value> to move string, e.g., F2000
        move_command_str += " " + PARAM_F + str(feed_rate_value)   
    
    # Remove excess whitespace on ends
    move_command_str = move_command_str.strip(" ")
    return move_command_str


############################################
############################################
############################################
    
''' Here's the main method of the script that uses the helper methods above '''

def generate_gcode():
    # List to hold all the move commands
    all_gcode_commands = []
    
    # Initialize the current position
    current_position = [0, 0, 0]

    # Iterate through each layer of the print
    for layer_index in range(len(lines)):
        # Move to the appropriate Z position for the current layer
        z_position = layer_index * layer_height
        z_position_command = gcode_move(current_position, [0, 0, z_position], feed_rate=layer_change_feed_rate)
        all_gcode_commands.append(z_position_command)

        # Update the current position to the new Z position
        current_position[2] = z_position
        
        # Iterate through each line segment within the layer
        for line_segment in lines:
            line_start_position = line_segment[0]
            line_end_position = line_segment[1]

            # Move to the start position of the line segment
            move_to_line_start_command = gcode_move(current_position, line_start_position, extrusion_feed_rate)
            all_gcode_commands.append(move_to_line_start_command)

            # Extrude material while moving along the line segment
            extrusion_move_command = gcode_move(line_start_position, line_end_position, extrusion_feed_rate, shouldExtrude=True)
            all_gcode_commands.append(extrusion_move_command)

            # Update the current position to the end of the line segment
            current_position = line_end_position

    # Now if our current_position is not the start of our line segment
    # we need to move (travel) to the line segment's starting point
    if not is_same_pt(current_position, line_start_position):
        # Move to the line_start_position
        move_to_line_start_command = gcode_move(current_position, line_start_position, extrusion_feed_rate)
        # Append command
        all_gcode_commands.append(move_to_line_start_command)

    # Combine the start_gcode, all_gcode_commands, and end_gcode into one list called gcode_lines
    gcode_lines = start_gcode_lines + all_gcode_commands + end_gcode_lines
    
    # --- DO NOT EDIT BELOW ----
    # The takes the combined gcode_lines list and creates a string containing each line
    # separated by a COMMAND_DELIMITER (the new-line character), and sets it 
    # to the `gcode_output`variable of this component
    output = COMMAND_DELIMITER.join(gcode_lines)
    
    return output
    
''' RUN THE MAIN FUNCITON ABOVE - DO NOT EDIT '''
# this sets the gcode commands to be the the `gcode_output` variable of this grasshopper component
gcode_output = generate_gcode()
# ---------- end ghpython_script ----------
debugging_panel = Panel(ghpython_script.out)
the_gcode_output = Panel(ghpython_script.gcode_output)
# [TODO]: Use Pancake Plug-in to Export Gcode Output File as .gcode
panel_7 = Panel("C:\Users\Chris\Downloads\Output.gcode")
true_only_button = TrueOnlyButton(LastSaveLocalization="neutral,N")
export_txt = ExportTXT(
    Content=the_gcode_output,
    FileLocation=panel_7,
    Overwrite=Toggle(True),
    Encoding="utf-8",
    Export=true_only_button,
    LastSaveLocalization="neutral,N")
panel_8 = Panel(export_txt)
